# Grasshopper definition test_step_joint.ghx (Grasshopper 1.0.7)
# plug-ins: Human

# ---- group: MainBeam
crv = Curve([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])
item = ListItem(List=crv, Index=Slider(0, range=0..2), Wrap=True)

# ---- group: CrossBeam
crv_2 = Curve(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)

# ---- group: StepShape
tapered_heel = BooleanToggle(True)  # disabled
number_slider = Slider(0, range=0..200)  # disabled
number_slider_2 = Slider(20, range=0..200)  # disabled

# ---- group: Tenon/Mortise
tenon_mortise_height = Slider(0, range=0..100)  # disabled

# ---- group: Ref_Side
number_slider_3 = Slider(2, range=0..15)  # disabled
number_slider_4 = Slider(0, range=0..5)  # disabled

# ----
beam = CTBeam(Centerline=item, Width=Slider(60, range=0..100), Height=Slider(80, range=0..100))  # -> Beam, Blank; inputs Centerline: list, ZVector: list of Vector3d, Width: list, Height: list, Category: list, updateRefObj: Boolean
#   port Centerline: Referenced curve or line, Guid of curve or line in the active Rhino document.
#   port ZVector: Vector defining the orientation of the cross-section (corresponds to the height dimension). If None, a default will be taken.
#   port Width: Width of the cross-section (usually the smaller dimension).
#   port Height: Height of the cross-section (usually the larger dimension).
#   port Category: Category of a beam.
#   port updateRefObj: (optional) If True, the attributes in the referenced object will be updated/overwritten with the new values given here.
#   port Beam: Beam object(s).
#   port Blank: Shape of the beam's blank.
# ---------- beam: Python ----------
"""Creates a Beam from a LineCurve."""

import rhinoscriptsyntax as rs
from compas.scene import Scene
from compas_rhino.conversions import line_to_compas
from compas_rhino.conversions import vector_to_compas
from ghpythonlib.componentbase import executingcomponent as component
from Grasshopper.Kernel.GH_RuntimeMessageLevel import Error
from Grasshopper.Kernel.GH_RuntimeMessageLevel import Warning
from Rhino.RhinoDoc import ActiveDoc

from compas_timber.elements import Beam as CTBeam
from compas_timber.ghpython.rhino_object_name_attributes import update_rhobj_attributes_name


class Beam_fromCurve(component):
    def RunScript(self, centerline, z_vector, width, height, category, updateRefObj):
        # minimum inputs required
        if not centerline:
            self.AddRuntimeMessage(Warning, "Input parameter 'Centerline' failed to collect data")
        if not width:
            self.AddRuntimeMessage(Warning, "Input parameter 'Width' failed to collect data")
        if not height:
            self.AddRuntimeMessage(Warning, "Input parameter 'Height' failed to collect data")

        # reformat unset parameters for consistency
        if not z_vector:
            z_vector = [None]
        if not category:
            category = [None]

        beams = []
        blanks = []
        scene = Scene()

        if centerline and height and width:
            # check list lengths for consistency
            N = len(centerline)
            if len(z_vector) not in (0, 1, N):
                self.AddRuntimeMessage(
                    Error, " In 'ZVector' I need either none, one or the same number of inputs as the Crv parameter."
                )
            if len(width) not in (1, N):
                self.AddRuntimeMessage(
                    Error, " In 'W' I need either one or the same number of inputs as the Crv parameter."
                )
            if len(height) not in (1, N):
                self.AddRuntimeMessage(
                    Error, " In 'H' I need either one or the same number of inputs as the Crv parameter."
                )
            if len(category) not in (0, 1, N):
                self.AddRuntimeMessage(
                    Error, " In 'Category' I need either none, one or the same number of inputs as the Crv parameter."
                )

            # duplicate data if None or single value
            if len(z_vector) != N:
                z_vector = [z_vector[0] for _ in range(N)]
            if len(width) != N:
                width = [width[0] for _ in range(N)]
            if len(height) != N:
                height = [height[0] for _ in range(N)]
            if len(category) != N:
                category = [category[0] for _ in range(N)]

            for line, z, w, h, c in zip(centerline, z_vector, width, height, category):
                guid, geometry = self._get_guid_and_geometry(line)
                rhino_line = rs.coerceline(geometry)
                line = line_to_compas(rhino_line)

                z = vector_to_compas(z) if z else None
                beam = CTBeam.from_centerline(centerline=line, width=w, height=h, z_vector=z)
                beam.attributes["rhino_guid"] = str(guid) if guid else None
                beam.attributes["category"] = c
                print(guid)
                if updateRefObj and guid:
                    update_rhobj_attributes_name(guid, "width", str(w))
                    update_rhobj_attributes_name(guid, "height", str(h))
                    update_rhobj_attributes_name(guid, "zvector", str(list(beam.frame.zaxis)))
                    update_rhobj_attributes_name(guid, "category", c)

                beams.append(beam)
                scene.add(beam.blank)

        blanks = scene.draw()

        return beams, blanks

    def _get_guid_and_geometry(self, line):
        # internalized curves and GH geometry will not have persistent GUIDs, referenced Rhino objects will
        # type hint on the input has to be 'ghdoc' for this to work
        guid = None
        geometry = line
        rhino_obj = ActiveDoc.Objects.FindId(line)
        if rhino_obj:
            guid = line
            geometry = rhino_obj.Geometry
        return guid, geometry
# ---------- end beam ----------
beam_2 = CTBeam(Centerline=crv_2, Width=Slider(80, range=0..100), Height=Slider(120, range=0..120))  # -> Beam, Blank; inputs Centerline: list, ZVector: list of Vector3d, Width: list, Height: list, Category: list, updateRefObj: Boolean; same code as beam

toggle = BooleanToggle(False)  # disabled
number_slider_5 = Slider(20, range=0..100)  # disabled
number_slider_6 = Slider(10, range=0..100)  # disabled
number_slider_7 = Slider(0, range=0..100)  # disabled

list = ValueList({"step": 0, "heel": 1, "double": 2}, selected="step")

# ----
# TStepJoint
python = GhPythonScript(
    cross_beam=beam_2.Beam,
    main_beam=beam.Beam,
    step_shape=list,
    step_depth=number_slider_5,
    heel_depth=number_slider_6,
    tapered_heel=toggle,
    tenon_mortise_height=number_slider_7)  # -> out, geometry, BTLx; inputs step_shape: Int32
# ---------- python: Python ----------
from compas_timber.connections import TStepJoint

from compas_timber.model import TimberModel
from compas_timber.fabrication import BTLx

from compas_rhino.conversions import brep_to_rhino

from compas_rhino import unload_modules

unload_modules("compas_timber")

# Instantiate TimberModel & Add Beams
timber_model = TimberModel()
beams = [cross_beam, main_beam]
for beam in beams:
    beam.remove_features()
    timber_model.add_element(beam)

# Create TStepJoint joint
step_joint_joint = TStepJoint.create(
    timber_model,
    main_beam,
    cross_beam,
    step_shape=step_shape,
    step_depth=step_depth,
    heel_depth=heel_depth,
    tapered_heel=tapered_heel,
    tenon_mortise_height=tenon_mortise_height
    )

# Process Joinery
timber_model.process_joinery()

# Generate Geometry
geometry = [brep_to_rhino(beam.compute_geometry()) for beam in timber_model.beams]

# Write BTLx
btlx = BTLx(timber_model)
BTLx = btlx.btlx_string()
# ---------- end python ----------
panel = Panel(python.out)

# ----
# StepJoint
python_2 = GhPythonScript(
    cross_beam=beam_2.Beam,
    main_beam=beam.Beam,
    index=number_slider_3,
    ref_side_index=number_slider_4,
    step=number_slider,
    heel=number_slider_2,
    tapered=tapered_heel,
    tenon_height=tenon_mortise_height)  # -> out, step_joint, rg_cutting_plane, rg_planes, rg_ref_side, rg_geometry, btlx_params; inputs index: Int32, ref_side_index: Int32; disabled
# ---------- python_2: Python ----------
import compas
from compas_rhino.conversions import surface_to_rhino
from compas_timber._fabrication import StepJointNotch
from compas_timber._fabrication import StepJointNotchParams
from compas_timber._fabrication import StepJoint
from compas_timber._fabrication import StepJointParams

from compas_timber.model import TimberModel
from compas_timber.fabrication import BTLx

from compas_rhino import unload_modules
from compas.scene import SceneObject

from compas_rhino.conversions import frame_to_rhino, plane_to_rhino, surface_to_rhino, polyline_to_rhino, brep_to_rhino, mesh_to_rhino

import Rhino.Geometry as rg
unload_modules("compas_timber")

#define beam and cutting plane
beam = main_beam
geo = beam.compute_geometry(False)
plane = cross_beam.ref_sides[index]

#create step_joint
step_joint = StepJoint.from_plane_and_beam(plane, beam, step, heel, tapered, ref_side_index)
cutting_planes = step_joint.planes_from_params_and_beam(beam)
print("Orientation: ", step_joint.orientation)
print("StrutInclination: ", step_joint.strut_inclination)

#add tenon
if tenon_height > 0:
    step_joint.add_tenon(cross_beam.width/4, tenon_height)
    tenon_volume = step_joint.tenon_volume_from_params_and_beam(beam)
    tenon_volume = brep_to_rhino(tenon_volume)

#apply geometric features
geometry = step_joint.apply(geo, beam)
rg_geometry = brep_to_rhino(geometry)
rg_geometry.MergeCoplanarFaces(0.01)

#get btlx params
step_joint_params = StepJointParams(step_joint).as_dict()
btlx_params = []
for key, value in step_joint_params.items():
    btlx_params.append("{0}: {1}".format(key, value))

#vizualize in rhino
rg_ref_side = frame_to_rhino(beam.ref_sides[ref_side_index])
rg_cutting_plane = frame_to_rhino(plane)
rg_planes = (plane_to_rhino(plane) for plane in cutting_planes)
# ---------- end python_2 ----------
panel_2 = Panel(python_2.out)  # disabled
btlx_params = Panel(python_2.btlx_params)  # disabled

# ----
# StepJointNotch
python_3 = GhPythonScript(
    cross_beam=beam_2.Beam,
    main_beam=beam.Beam,
    index=number_slider_4,
    ref_side_index=number_slider_3,
    step=number_slider,
    heel=number_slider_2,
    tapered=tapered_heel,
    mortise_height=tenon_mortise_height)  # -> out, step_joint_notch, rg_cutting_plane, rg_planes, rg_ref_side, rg_geometry, btlx_params; inputs index: Int32, ref_side_index: Int32; disabled
# ---------- python_3: Python ----------
from compas_rhino.conversions import surface_to_rhino
from compas_timber._fabrication import StepJointNotch
from compas_timber._fabrication import StepJointNotchParams

from compas_timber.model import TimberModel
from compas_timber.fabrication import BTLx

from compas_rhino import unload_modules
from compas.scene import SceneObject

from compas_rhino.conversions import frame_to_rhino, plane_to_rhino, surface_to_rhino, polyline_to_rhino, brep_to_rhino

import Rhino.Geometry as rg
unload_modules("compas_timber")

#define beam and cutting plane
beam = cross_beam
plane = main_beam.ref_sides[index]

#create step_joint_notch
step_joint_notch = StepJointNotch.from_plane_and_beam(plane, beam, start_y=0.0, notch_limited=False, step_depth=step, heel_depth=heel, strut_height=100.0, tapered_heel=tapered, ref_side_index=ref_side_index)
cutting_planes = step_joint_notch.planes_from_params_and_beam(beam)

print("Orientation: ", step_joint_notch.orientation)
print("StrutInclination: ", step_joint_notch.strut_inclination)

#add mortise
if mortise_height > 0:
    step_joint_notch.add_mortise(beam.width/4, mortise_height, beam)
    mortise_brep = step_joint_notch.mortise_volume_from_params_and_beam(beam)
    mortise_brep = brep_to_rhino(mortise_brep)

#apply geometric features
geo = beam.compute_geometry(False)
geometry = step_joint_notch.apply(geo, beam)
rg_geometry = brep_to_rhino(geometry)

#get btlx params
step_joint_notch_params = StepJointNotchParams(step_joint_notch).as_dict()
btlx_params = []
for key, value in step_joint_notch_params.items():
    btlx_params.append("{0}: {1}".format(key, value))


#vizualize in rhino
rg_ref_side = frame_to_rhino(beam.ref_sides[ref_side_index])
rg_cutting_plane = frame_to_rhino(plane)
rg_planes = (plane_to_rhino(plane) for plane in cutting_planes)
# ---------- end python_3 ----------
panel_3 = Panel(python_3.out)  # disabled
btlx_params_2 = Panel(python_3.btlx_params)  # disabled

# ---- group: GEOMETRY
brep = Brep(python.geometry)
entwine = Entwine(
    Branch00=ColourSwatch(SwatchColor=RGBA(0, 102, 255, 29)),
    Branch01=ColourSwatch(SwatchColor=RGBA(240, 180, 137, 34)),
    FlattenInputs=True)
edges = BrepEdges(Brep=brep)  # -> Naked, Interior, NonManifold
previewlw = CustomPreviewLineweights(Geometry=edges.Interior, Shader=graft(entwine), Absolute=False)
preview = CustomPreview(Geometry=brep, Material=flatten(entwine))

brep_2 = Brep(python_2.rg_geometry)  # disabled
swatch = ColourSwatch(SwatchColor=RGBA(0, 102, 255, 29))  # disabled
edges_2 = BrepEdges(Brep=brep_2)  # -> Naked, Interior, NonManifold; disabled
previewlw_2 = CustomPreviewLineweights(Geometry=edges_2.Interior, Shader=swatch, Absolute=False)  # disabled
preview_2 = CustomPreview(Geometry=brep_2, Material=swatch)  # disabled

brep_3 = Brep(python_3.rg_geometry)  # disabled
swatch_2 = ColourSwatch(SwatchColor=RGBA(240, 180, 137, 34))  # disabled
edges_3 = BrepEdges(Brep=brep_3)  # -> Naked, Interior, NonManifold; disabled
preview_3 = CustomPreview(Geometry=brep_3, Material=swatch_2)  # disabled
previewlw_3 = CustomPreviewLineweights(Geometry=edges_3.Interior, Shader=swatch_2, Absolute=False)  # disabled

# ---- group: CUTTING PLANE
pln = Plane(python_2.rg_cutting_plane)  # disabled

# ---- group: REF_SIDE
pln_2 = Plane(python_2.rg_ref_side)  # disabled

# ---- group: CUTTING PLANE
pln_3 = Plane(python_3.rg_cutting_plane)  # disabled

# ---- group: notch_planes
pln_4 = Plane(python_2.rg_planes)  # disabled

# ---- group: REF_SIDE
pln_5 = Plane(python_3.rg_ref_side)  # disabled

# ---- group: notch_planes
pln_6 = Plane(python_3.rg_planes)  # disabled

# ----
panel_4 = Panel(python.BTLx)
